# Dynamo graph CARGAR PARÁMETROS COMPARTIDOS.dyn (Dynamo 2.19.3.6394)

python_script = Python()  # IronPython2; unwired: IN[0]
# ---------- python_script.python (56 lines) ----------
import clr
clr.AddReference('RevitAPI')
from Autodesk.Revit.DB import *

clr.AddReference('RevitServices')
import RevitServices
from RevitServices.Persistence import DocumentManager
from RevitServices.Transactions import TransactionManager

doc = DocumentManager.Instance.CurrentDBDocument
app = doc.Application

# --- CONFIGURACIÓN ---
ruta_txt = r"Z:\0.0 BIM\PARAMETROS COMPARTIDOS.txt"
nombres_parametros = ["MATERIAL INTEGRADO", "NIVEL INTEGRADO"]

# 1. Cargar archivo de parámetros
app.SharedParametersFilename = ruta_txt
def_file = app.OpenSharedParameterFile()

if not def_file:
    OUT = "Error: No se pudo abrir el archivo de parámetros en la ruta especificada."
else:
    # 2. Preparar categorías (Selecciona todas las que permiten parámetros)
    cat_set = app.Create.NewCategorySet()
    for cat in doc.Settings.Categories:
        if cat.AllowsBoundParameters:
            cat_set.Insert(cat)

    # 3. Iniciar Transacción
    TransactionManager.Instance.EnsureInTransaction(doc)
    
    resultados = []
    
    try:
        for nombre in nombres_parametros:
            param_def = None
            # Buscar el parámetro en cualquier grupo del archivo TXT
            for group in def_file.Groups:
                param_def = group.Definitions.Item[nombre]
                if param_def: break
            
            if param_def:
                binding = app.Create.NewInstanceBinding(cat_set)
                # Insertar (usamos el grupo PG_MATERIALS para ambos o puedes cambiarlo)
                doc.ParameterBindings.Insert(param_def, binding, BuiltInParameterGroup.PG_MATERIALS)
                resultados.append("Éxito: " + nombre)
            else:
                resultados.append("No encontrado: " + nombre)
        
        out_msg = "\n".join(resultados)
    except Exception as e:
        out_msg = "Error: " + str(e)

    TransactionManager.Instance.TransactionTaskDone()
    OUT = out_msg
# ----------------------------------------
watch = Watch(python_script)
