# Dynamo graph COPIAR SUBPROYECTOS A SUBPROYECTOS INTEGRADO.dyn (Dynamo 2.19.3.6394)

python_script = Python()  # IronPython2; unwired: IN[0]
# ---------- python_script.python (49 lines) ----------
import clr

# Importar la API de Revit
clr.AddReference('RevitAPI')
from Autodesk.Revit.DB import *

# Importar el Gestor de Documentos
clr.AddReference('RevitServices')
import RevitServices
from RevitServices.Persistence import DocumentManager
from RevitServices.Transactions import TransactionManager

# Obtener el documento actual
doc = DocumentManager.Instance.CurrentDBDocument

# 1. Recolectar todos los elementos del modelo (excluyendo tipos)
collector = FilteredElementCollector(doc).WhereElementIsNotElementType()

# 2. Iniciar la transacción para poder escribir datos
TransactionManager.Instance.EnsureInTransaction(doc)

count = 0
errors = 0

for item in collector:
    try:
        # Obtener el ID del subproyecto del elemento
        workset_id = item.WorksetId
        
        # Obtener el nombre del subproyecto desde la tabla de subproyectos
        workset_table = doc.GetWorksetTable()
        workset = workset_table.GetWorkset(workset_id)
        workset_name = workset.Name
        
        # Buscar nuestro parámetro personalizado
        param = item.LookupParameter("SUBPROYECTOS INTEGRADO")
        
        # Si el parámetro existe y no es de solo lectura, escribimos el nombre
        if param and not param.IsReadOnly:
            param.Set(workset_name)
            count += 1
    except:
        errors += 1

# Finalizar la transacción
TransactionManager.Instance.TransactionTaskDone()

# Salida para Dynamo
OUT = "Proceso finalizado. {} elementos actualizados. {} errores.".format(count, errors)
# ----------------------------------------
watch = Watch(python_script)
