# Dynamo graph Home 1.dyn (Dynamo 2.19.3.6394)

categories = Categories("OST_Walls")
all_elements_of_category = ElementsOfCategory(Category=categories)
categories_2 = Categories("OST_Floors")
all_elements_of_category_2 = ElementsOfCategory(Category=categories_2)
list_create = List.Create(item0=all_elements_of_category, item1=all_elements_of_category_2)
flatten = List.Flatten(list=list_create)
python_script = Python(IN[0]=flatten)  # CPython3
# ---------- python_script.python (56 lines) ----------
import clr

clr.AddReference('RevitAPI')
from Autodesk.Revit.DB import *

clr.AddReference('RevitServices')
import RevitServices
from RevitServices.Persistence import DocumentManager
from RevitServices.Transactions import TransactionManager

doc = DocumentManager.Instance.CurrentDBDocument

# Función para manejar listas o elementos sueltos y desenrollarlos
def to_list(input):
    if isinstance(input, list): return [UnwrapElement(i) for i in input]
    else: return [UnwrapElement(input)]

elementos = to_list(IN[0])
resultados = []

TransactionManager.Instance.EnsureInTransaction(doc)

for e in elementos:
    try:
        if e is None: continue
        
        # Obtener el tipo de muro/suelo
        e_type = doc.GetElement(e.GetTypeId())
        
        # Obtener la estructura
        comp_struc = e_type.GetCompoundStructure()
        nombre_mat = "Sin Material"
        
        if comp_struc is not None:
            # Accedemos a las capas de forma segura
            capas = comp_struc.GetLayers()
            for capa in capas:
                m_id = capa.MaterialId
                if m_id != ElementId.InvalidElementId:
                    nombre_mat = doc.GetElement(m_id).Name
                    break # Sale al encontrar el primer material
        
        # Escribir en el parámetro de INSTANCIA
        param = e.LookupParameter("MATERIAL COMBINADO")
        if param and not param.IsReadOnly:
            param.Set(nombre_mat)
            resultados.append("Listo: " + nombre_mat)
        else:
            resultados.append("Error: No existe el parámetro en el elemento")
            
    except Exception as ex:
        resultados.append("Fallo: " + str(ex))

TransactionManager.Instance.TransactionTaskDone()

OUT = resultados
# ----------------------------------------
