# Dynamo graph INTEGRACIÓN.dyn (Dynamo 2.19.3.6394)

nivel_integrado = Python()  # IronPython2; unwired: IN[0]
# ---------- nivel_integrado.python (64 lines) ----------
import clr

# Importar Revit API
clr.AddReference('RevitAPI')
from Autodesk.Revit.DB import *

# Importar DocumentManager y TransactionManager
clr.AddReference('RevitServices')
import RevitServices
from RevitServices.Persistence import DocumentManager
from RevitServices.Transactions import TransactionManager

doc = DocumentManager.Instance.CurrentDBDocument

# 1. Obtener todos los elementos del modelo que no sean tipos
col = FilteredElementCollector(doc).WhereElementIsNotElementType().ToElements()

# 2. Lista de parámetros en orden de prioridad
nombres_busqueda = ["Nivel de referencia", "Nivel", "Nivel base", "Restricción de base"]
parametro_destino = "NIVEL INTEGRADO"

TransactionManager.Instance.EnsureInTransaction(doc)

conteo_exitos = 0

for el in col:
    # Solo procesar elementos que tengan el parámetro destino
    p_dest = el.LookupParameter(parametro_destino)
    
    if p_dest and not p_dest.IsReadOnly:
        valor_encontrado = None
        
        # 3. Buscar el primer parámetro que coincida y tenga valor
        for nombre in nombres_busqueda:
            p_origen = el.LookupParameter(nombre)
            
            if p_origen and p_origen.HasValue:
                # Intentamos obtener el valor como texto (Nombre del nivel)
                valor_encontrado = p_origen.AsValueString()
                
                # Si AsValueString falla (a veces pasa en ciertos parámetros), 
                # intentamos obtener el nombre a través del ElementId
                if not valor_encontrado:
                    id_nivel = p_origen.AsElementId()
                    if id_nivel and id_nivel != ElementId.InvalidElementId:
                        nivel_obj = doc.GetElement(id_nivel)
                        if nivel_obj:
                            valor_encontrado = nivel_obj.Name
                
                if valor_encontrado:
                    break
        
        # 4. Escribir el valor en NIVEL INTEGRADO
        if valor_encontrado:
            try:
                p_dest.Set(valor_encontrado)
                conteo_exitos += 1
            except:
                continue

TransactionManager.Instance.TransactionTaskDone()

# Salida con el conteo de elementos afectados
OUT = "Proceso completado. Se actualizaron {} elementos.".format(conteo_exitos)
# ----------------------------------------
watch = Watch(nivel_integrado)
material_integrado = Python()  # IronPython2; unwired: IN[0]
# ---------- material_integrado.python (63 lines) ----------
import clr

clr.AddReference('RevitAPI')
from Autodesk.Revit.DB import *

clr.AddReference('RevitServices')
import RevitServices
from RevitServices.Persistence import DocumentManager
from RevitServices.Transactions import TransactionManager

doc = DocumentManager.Instance.CurrentDBDocument

# Recolectar TODOS los elementos que no sean tipos y tengan nombre
collector = FilteredElementCollector(doc).WhereElementIsNotElementType().ToElements()

resultados = []

TransactionManager.Instance.EnsureInTransaction(doc)

for e in collector:
    try:
        if e.Category is None: continue
        
        nombre_mat = None
        type_id = e.GetTypeId()
        e_type = doc.GetElement(type_id) if type_id != ElementId.InvalidElementId else None
        
        # ESTRATEGIA 1: Buscar en estructuras compuestas (Muros, Suelos, Techos)
        if e_type and hasattr(e_type, "GetCompoundStructure"):
            comp_struc = e_type.GetCompoundStructure()
            if comp_struc:
                m_id = comp_struc.GetLayers()[0].MaterialId
                if m_id != ElementId.InvalidElementId:
                    nombre_mat = doc.GetElement(m_id).Name

        # ESTRATEGIA 2: Si sigue vacío, buscar parámetro de Material (Columnas, Vigas, Familias cargables)
        if not nombre_mat:
            # Intentamos con parámetros comunes de material
            for p_name in ["Material", "Structural Material", "Material estructural"]:
                p = e.LookupParameter(p_name)
                if p and p.AsElementId() != ElementId.InvalidElementId:
                    nombre_mat = doc.GetElement(p.AsElementId()).Name
                    break

        # ESTRATEGIA 3: Buscar en el Tipo (si no está en la instancia)
        if not nombre_mat and e_type:
            p = e_type.LookupParameter("Material")
            if p and p.AsElementId() != ElementId.InvalidElementId:
                nombre_mat = doc.GetElement(p.AsElementId()).Name

        # ESCRIBIR RESULTADO
        if nombre_mat:
            param_destino = e.LookupParameter("MATERIAL INTEGRADO")
            if param_destino and not param_destino.IsReadOnly:
                param_destino.Set(nombre_mat)
                resultados.append(e.Category.Name + ": " + nombre_mat)
                
    except Exception:
        continue

TransactionManager.Instance.TransactionTaskDone()

OUT = resultados 
# ----------------------------------------
watch_2 = Watch(material_integrado)
dimensiones_integradas = Python()  # IronPython2; unwired: IN[0]
# ---------- dimensiones_integradas.python (83 lines) ----------
import clr

clr.AddReference('RevitAPI')
from Autodesk.Revit.DB import *

clr.AddReference('RevitServices')
import RevitServices
from RevitServices.Persistence import DocumentManager
from RevitServices.Transactions import TransactionManager

doc = DocumentManager.Instance.CurrentDBDocument

# Colectar todos los elementos que no sean Tipos (instancias de modelo)
collector = FilteredElementCollector(doc).WhereElementIsNotElementType().ToElements()

opt = Options()
opt.DetailLevel = ViewDetailLevel.Fine
opt.ComputeReferences = True
opt.IncludeNonVisibleObjects = False # Evita líneas ocultas que falsean la longitud

TransactionManager.Instance.EnsureInTransaction(doc)

contador = 0

for el in collector:
    # Saltar elementos sin categoría (como materiales o estilos)
    if el.Category is None: continue
    
    # Solo procesar categorías de modelo comunes
    if el.Category.CategoryType != CategoryType.Model: continue

    try:
        geom = el.get_Geometry(opt)
        if not geom: continue
        
        vol_total = 0.0
        max_f_area = 0.0
        max_e_long = 0.0
        encontrado = False

        # Extraer todos los sólidos, incluso dentro de GeometryInstances
        solidos = []
        for obj in geom:
            if isinstance(obj, Solid):
                solidos.append(obj)
            elif isinstance(obj, GeometryInstance):
                # Importante: GetSymbolGeometry() para familias o GetInstanceGeometry()
                solidos.extend([s for s in obj.GetInstanceGeometry() if isinstance(s, Solid)])

        for s in solidos:
            if s.Volume > 0.000001: # Filtro de precisión
                encontrado = True
                vol_total += s.Volume
                for face in s.Faces:
                    if face.Area > max_f_area: max_f_area = face.Area
                    for loop in face.EdgeLoops:
                        for edge in loop:
                            if edge.ApproximateLength > max_e_long:
                                max_e_long = edge.ApproximateLength

        if encontrado:
            # Intentar escribir en los parámetros si existen
            params = {
                "VOLUMEN INTEGRADO": vol_total,
                "AREA INTEGRADO": max_f_area,
                "LONGITUD INTEGRADO": max_e_long
            }
            
            p_exito = False
            for p_nombre, p_valor in params.items():
                p = el.LookupParameter(p_nombre)
                if p and not p.IsReadOnly:
                    p.Set(p_valor)
                    p_exito = True
            
            if p_exito: contador += 1

    except:
        continue

TransactionManager.Instance.TransactionTaskDone()

OUT = "Listo. Se actualizaron {} elementos del modelo.".format(contador)
# ----------------------------------------
watch_3 = Watch(dimensiones_integradas)
